# Grasshopper definition column_script.gh (Grasshopper 1.0.7)
# plug-ins: karambaGH

c_script = CSharpScript(Reference=["C:\Users\hnatsume\AppData\Roaming\Grasshopper\Libraries\Karamba\karambaCommon.dll", "C:\Users\hnatsume\AppData\Roaming\Grasshopper\Libraries\Karamba\karamba.gha"])  # -> out, ModelOut, MaxDisp
# ---------- c_script: C# usings ----------
using System.Linq;
using Karamba.Utilities;
using Karamba.Geometry;
using Karamba.CrossSections;
using Karamba.Supports;
using Karamba.Loads;
# ---------- c_script: C# ----------
    var logger = new MessageLogger();
    var k3d = new KarambaCommon.Toolkit();

    var p0 = new Point3(0, 0, 0);
    var p1 = new Point3(0, 0, 5);
    var L0 = new Line3(p0, p1);

    var nodes = new List<Point3>();

    var elems = k3d.Part.LineToBeam(new List<Line3>(){L0}, new List<string>(){ "B1" }, new List<CroSec>(), logger, out nodes);

    var support = k3d.Support.Support(p0, new List<bool>(){true, true, true, true, true, true});
    var supports = new List<Support>(){support};

    var pload = k3d.Load.PointLoad(p1, new Vector3(0, 0, -10));
    var ploads = new List<Load>(){pload};

    double mass;
    Point3 cog;
    bool flag;
    string info;
    var model = k3d.Model.AssembleModel(elems, supports, ploads,
      out info, out mass, out cog, out info, out flag);

    // calculate Th.I response
    List<double> max_disp;
    List<double> out_g;
    List<double> out_comp;
    string message;
    model = k3d.Algorithms.AnalyzeThI(model, out max_disp, out out_g, out out_comp, out message);

    var ucf = UnitsConversionFactories.Conv();
    UnitConversion cm = ucf.cm();
    Print("max disp: " + cm.toUnit(max_disp[0]) + cm.unitB);

    ModelOut = new Karamba.GHopper.Models.GH_Model(model);
    MaxDisp = cm.toUnit(max_disp.Max());
# ---------- end c_script ----------
panel = Panel(c_script.MaxDisp)
modelview = ModelViewKaramba3D(Model=c_script.ModelOut, ResultFactors=1, ResultCase=-1)  # -> Model, DeformedMesh, DeformedAxes, DeformedModel
beamview = BeamViewKaramba3D(Model=modelview.Model)  # -> Model, MeshesOfRenderedBeams, DeformedBeamAxes, LegendColors, LegendTags
